# Dynamo graph Dimensionline_Center_MF.dyn (Dynamo 2.19.3.6394)

select_model_elements = DSModelElementsSelection()  # 4 picked in the model; graph input
select_model_element = DSModelElementSelection()  # 1 picked in the model

# group: Text CenterLine
# Revit Facebook Group
ʳʰʸᵗʰᵐ_dimensions = Rhythm.Revit.Elements.Dimensions.CenterTextOnLine(dimension=select_model_element)
