# Dynamo graph MF_Grid-SwitchTo2DExtents.dyn "171121_Grid-SwitchTo2DExtents" (Dynamo 2.0.2.6826)

select_model_elements = DSModelElementsSelection()  # nothing selected; graph input
boolean = BoolSelector(false)
active_view = Custom[Active View](refresh=boolean)  # Selects the current document's active view. Supports more view types
python_script = Python(IN[0]=select_model_elements, IN[1]=active_view)
# ---------- python_script.python (25 lines) ----------
import clr
clr.AddReference('RevitAPI')
from Autodesk.Revit.DB import *
import Autodesk

clr.AddReference("RevitServices")
import RevitServices
from RevitServices.Persistence import DocumentManager
from RevitServices.Transactions import TransactionManager

doc = DocumentManager.Instance.CurrentDBDocument
uiapp = DocumentManager.Instance.CurrentUIApplication
app = uiapp.Application

a = UnwrapElement(IN[0])
v = UnwrapElement(IN[1])
TransactionManager.Instance.EnsureInTransaction(doc)
for i in a:
#    i.SetDatumExtentType(DatumEnds.End0,v, DatumExtentType.Model)
    i.SetDatumExtentType(DatumEnds.End0,v, DatumExtentType.ViewSpecific)
#    i.SetDatumExtentType(DatumEnds.End1,v, DatumExtentType.Model)
    i.SetDatumExtentType(DatumEnds.End1,v, DatumExtentType.ViewSpecific)
TransactionManager.Instance.TransactionTaskDone()

OUT = v
# ----------------------------------------
